# Grasshopper definition 2F_guke.gh (Grasshopper 1.0.7)
# plug-ins: PedSim Pro, TT Toolbox

point = Point(<point referenced from the Rhino model>)
point_2 = Point(<point referenced from the Rhino model>)
point_3 = Point(<point referenced from the Rhino model>)
point_4 = Point(<point referenced from the Rhino model>)
point_5 = Point(<point referenced from the Rhino model>)
point_6 = Point(<point referenced from the Rhino model>)
point_7 = Point([<point referenced from the Rhino model> x3])
number_slider = Slider(0, range=0..100)
number_slider_2 = Slider(0, range=0..100)
number_slider_3 = Slider(10, range=0..100)
number_slider_4 = Slider(2, range=0..100)
number_slider_5 = Slider(2, range=0..100)
number_slider_6 = Slider(0, range=0..100)
number_slider_7 = Slider(2, range=0..10)  # disabled
number_slider_8 = Slider(5, range=0..100)
number_slider_9 = Slider(1.5, range=0..3)  # disabled
program = Program(ProgramName="entry", DisplayColor=RGBA(0, 0, 0, 0))
program_2 = Program(ProgramName="OUT", DisplayColor=RGBA(0, 0, 0, 0))
program_3 = Program(ProgramName="guahao machine", DisplayColor=RGBA(0, 0, 0, 0))
program_4 = Program(ProgramName="houzhen", DisplayColor=RGBA(0, 0, 0, 0))
program_5 = Program(ProgramName="quyao", DisplayColor=RGBA(0, 0, 0, 0))
program_6 = Program(ProgramName="guahao", DisplayColor=RGBA(0, 0, 0, 0))
program_7 = Program(ProgramName="2F", DisplayColor=RGBA(0, 0, 0, 0))
program_8 = Program(ProgramName="wenxun", DisplayColor=RGBA(0, 0, 0, 0))  # disabled
colour_swatch = ColourSwatch(SwatchColor=RGB(136, 177, 242))  # disabled
point_8 = Point(<point referenced from the Rhino model>)  # disabled
cross_reference = CrossReference(ListListA=point_7, ListListB=".", CrossMode=4)  # -> ListListA, ListListB
list_length = ListLength(List=point_7)
program_9 = Program(ProgramName="none", DisplayColor=ColourSwatch(SwatchColor=RGB(101, 145, 161)))
stand = Stand(
    Points=point,
    Names="entry",
    Programs=program,
    VisitingTime=number_slider,
    AccessRadius=Slider(1, range=0..1),
    Capacity=1,
    Color=ColourSwatch(SwatchColor=RGB(65, 171, 209)),
    creatingMultiple=True)
stand_2 = Stand(
    Points=point_5,
    Names="2F",
    Programs=program_7,
    VisitingTime=number_slider_6,
    AccessRadius=Slider(0.5, range=0..3),
    Capacity=15,
    Color=ColourSwatch(SwatchColor=RGB(252, 175, 8)),
    creatingMultiple=True)
room = Room(
    Points=point_3,
    Names="houzhen",
    Programs=program_4,
    VisitingTime=number_slider_3,
    AccessRadius=Slider(0.4, range=0..3),
    Capacity=Slider(5, range=0..15),
    Color=ColourSwatch(SwatchColor=RGB(109, 67, 161)),
    creatingMultiple=True)
room_2 = Room(
    Points=point_2,
    Names="guahao",
    Programs=program_6,
    VisitingTime=number_slider_5,
    AccessRadius=Slider(0.5, range=0..1),
    Capacity=Slider(15, range=0..15),
    Color=ColourSwatch(SwatchColor=RGB(21, 79, 36)),
    creatingMultiple=True)
stand_3 = Stand(
    Points=point_4,
    Names="quyao",
    Programs=program_5,
    VisitingTime=number_slider_4,
    AccessRadius=Slider(0.5, range=0..3),
    Capacity=Slider(4, range=0..15),
    Color=ColourSwatch(SwatchColor=RGB(34, 189, 158)),
    creatingMultiple=True)
stand_4 = Stand(
    Points=cross_reference.ListListA,
    Names=cross_reference.ListListB,
    Programs=program_3,
    VisitingTime=number_slider_8,
    AccessRadius=Slider(0.5, range=0..1),
    Capacity=list_length,
    Color=ColourSwatch(SwatchColor=RGB(245, 125, 125)),
    creatingMultiple=True)
stand_5 = Stand(
    Points=point_6,
    Names="OUT",
    Programs=program_2,
    VisitingTime=number_slider_2,
    AccessRadius=Slider(0.5, range=0..2),
    Capacity=15,
    Color=ColourSwatch(SwatchColor=RGB(0, 0, 0)),
    creatingMultiple=True)
stand_6 = Stand(
    Points=point_8,
    Names="wenxun",
    Programs=program_8,
    VisitingTime=number_slider_7,
    AccessRadius=number_slider_9,
    Capacity=2,
    Color=colour_swatch,
    creatingMultiple=True)  # disabled
panoramavision = PanoramaVision()
relay = Relay([program_3, program_8])
merge = Merge(Data1=stand, Data2=room_2, Data3=room, Data4=stand_3, Data5=stand_2, Data6=stand_5)
merge_2 = Merge(Data1=stand, Data2=room_2, Data3=room, Data4=stand_4, Data5=stand_2, Data6=stand_3, Data7=stand_6, Data8=stand_5)
personprofile = PersonProfile(
    Vision=panoramavision,
    BodyRadius=0.2,
    Mass=70,
    Speed=Slider(1.5, range=0..10),
    TargetForceCoef=500,
    Damping=500,
    DeviationTime=60,
    TargetSwitchTime=Slider(5, range=0..10),
    DoorSwitchTime=1,
    AbandoningTime=120)
merge_3 = Merge(
    Data1=number_slider,
    Data2=number_slider_5,
    Data3=number_slider_3,
    Data4=number_slider_8,
    Data5=number_slider_4,
    Data6=number_slider_7,
    Data7=number_slider_6,
    Data8=number_slider_2)
persontemplate = PersonTemplate(
    PersonProfile=personprofile,
    Stops=merge,
    Interests=relay,
    NeedValue=1,
    TemplateID="1",
    Probability=1,
    TimeLimit=-1,
    Color=RGBA(100, 100, 100, 155),
    PersonTemplateDirectionMode=1)
persontemplate_2 = PersonTemplate(
    PersonProfile=personprofile,
    Stops=merge,
    Interests=program_9,
    NeedValue=1,
    TemplateID="0",
    Probability=1,
    TimeLimit=-1,
    Color=RGBA(100, 100, 100, 155),
    PersonTemplateDirectionMode=1)
button = Button()
merge_4 = Merge(Data1=persontemplate_2, Data2=persontemplate)
curve = Curve([<curve referenced from the Rhino model> x4])
curve_2 = Curve(<curve referenced from the Rhino model>)
systemsettings = SystemSettings(
    FPS=Slider(20, range=0..30),
    ObstacleOffset=Slider(0.4, range=0..1),
    ObstacleRepulsionCoefA=Slider(500, range=0..1000),
    ObstacleRepulsionCoefB=Slider(0.1, range=0..0.1),
    ObstacleRepulsionMax=Slider(1000, range=0..1000),
    ObstacleRepulsionThreshold=Slider(0.7, range=0..1),
    PersonRepulsionCoefA=Slider(1000, range=0..1000),
    PersonRepulsionCoefB=Slider(0.1, range=0..1),
    PersonRepulsionMax=Slider(1000, range=0..1000),
    PersonRepulsionThreshold=Slider(1.1, range=0..10),
    AvoidanceAccelerationCoef=4,
    AvoidanceTimeHorizon=1.5,
    EnableTrace=Toggle(True))
pedsimengine = PedSimEngine(
    Reset=button,
    PersonTemplates=merge_4,
    Obstacles=curve_2,
    TransparentObstacles=curve,
    Population=Slider(25, range=0..100),
    Stops=merge_2,
    GenerationTime=Slider(40, range=0..50),
    SystemSettings=systemsettings)  # -> Out, People, PersonRecords, Stops, GraphEdges, GraphVertices
timer = Timer(TimerInterval=1, Target=pedsimengine)  # disabled
drawperson = DrawPerson(People=pedsimengine.People, drawCurrentTargetFill=True, drawFOV=True, drawNumber=True)
data = Data(pedsimengine.People)

# ---- group: 速度
number_slider_10 = Slider(2, range=0..10)
number_slider_11 = Slider(92, range=0..100)
number_slider_12 = Slider(51, range=0..100)
point_9 = Point(<point referenced from the Rhino model>)
gate_or = GateOr(A=button, B=Button())
gridspeedcounter = GridSpeedCounter(
    Reset=gate_or,
    People=pedsimengine.People,
    BasePt=point_9,
    CellSize=number_slider_10,
    ExtentX=number_slider_11,
    ExtentY=number_slider_12,
    NumFrames=20)  # -> AvgSpeed, MaxSpeed
square = Square(Plane=point_9, Size=number_slider_10, ExtentX=number_slider_11, ExtentY=number_slider_12)  # -> Cells, Points
number_slider_13 = Slider(1, range=0..1)
multiplication = Multiplication(A=gridspeedcounter.AvgSpeed, B=Slider(5, range=0..10))  # disabled
mesh_plane = MeshPlane(Boundary=flatten(square.Cells), WidthCount=number_slider_13, HeightCount=number_slider_13)  # -> Mesh, Area; disabled
colour_rgb = ColourRGB(Alpha=255, Red=multiplication, Green=multiplication, Blue=multiplication)  # disabled
custom_preview = CustomPreview(Geometry=mesh_plane.Mesh, Material=colour_rgb)  # disabled

# ----
deconstruct_person = DeconstructPerson(Person=data)  # -> ID, PersonTemplate, Position, Velocity, Acceleration, CurrentPath, CurrentAccessPoint, CurrentStopIndex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; disabled
deconstruct_person_2 = DeconstructPerson(Person=data)  # -> ID, PersonTemplate, Position, Velocity, Acceleration, CurrentPath, CurrentAccessPoint, CurrentStopIndex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

# ----
# 计数（简单）
deconstruct_stop = DeconstructStop(Stop=pedsimengine.Stops)  # -> AccessPoints, Name, Programs, Color, Visitors, QueueLength, VisitCount
deconstruct_access_point = DeconstructAccessPoint(AccessPoint=deconstruct_stop.AccessPoints)  # -> Position, Visitor, Waitlist, QueueLength
list_item = ListItem(List=deconstruct_stop.VisitCount, Index=0, Wrap=True)  # -> Item, Item1, Item2, Item3, Item4, Item5
division = Division(A=list_item.Item1, B=2)
division_2 = Division(A=list_item.Item4, B=2)
division_3 = Division(A=list_item.Item3, B=2)
division_4 = Division(A=list_item.Item5, B=2)
average = Average(Input=deconstruct_access_point.Position)  # -> flatten(ArithmeticMean)
absolute = Absolute(Value=division)
absolute_2 = Absolute(Value=division_2)
absolute_3 = Absolute(Value=division_3)
absolute_4 = Absolute(Value=division_4)
merge_5 = Merge(Data1=list_item.Item, Data2=absolute, Data3=list_item.Item2, Data4=absolute_3, Data5=absolute_2, Data6=absolute_4)
panel = Panel("Stop positions")
vector = Vector("0,0,3")
point_10 = Point(average)
integer = Integer(merge_5)
move = Move(Geometry=point_10, Motion=vector)  # -> Geometry, Transform
text_tag = TextTag(Location=move.Geometry, Text=integer, Colour=ColourSwatch(SwatchColor=RGB(105, 105, 105)))

deconstruct_ptemplate = DeconstructPTemplate(PersonTemplate=deconstruct_person_2.PersonTemplate)  # -> Stops, Interests, NeedValue, TemplateID, Probability, TimeLimit, Color

# ---- group: 路径跟踪
point_11 = Point(deconstruct_person.TracePositions)  # disabled
number = Number(deconstruct_person.TraceSpeeds)  # disabled
max_speed = Slider(1.75, range=0..3)  # disabled
shift_list = ShiftList(List=point_11, Shift=1, Wrap=False)  # disabled
# 路径跟踪
line = Line(StartPoint=point_11, EndPoint=shift_list)  # -> simplify(Line); disabled
number_2 = Number(max_speed)  # disabled
shortest_list = ShortestList(ListListA=line, ListListB=number, TrimMode=2)  # -> ListListA, ListListB; disabled
division_5 = Division(A=shortest_list.ListListB, B=number_2)  # -> simplify(Result); disabled
gradient = Gradient(
    LowerLimit=0,
    UpperLimit=1,
    Parameter=expr("1-x", division_5),
    stops=[0: RGB(111, 172, 222), 0.761: RGB(255, 255, 112), 1: RGB(255, 0, 0)])  # disabled
custom_preview_2 = CustomPreview(Geometry=line, Shader=gradient)  # disabled

# ----
equality = Equality(FirstNumber=gridspeedcounter.AvgSpeed, SecondNumber="0")  # -> Equality, Inequality
panel_2 = Panel("路径Path")
panel_3 = Panel("总需求Need summary")
panel_4 = Panel("入口点Access point")
panel_5 = Panel("速度Velocity")
panel_6 = Panel("模板名Template ID")
panel_7 = Panel("位置Pos")
curve_3 = Curve(deconstruct_person_2.CurrentPath)
vector_2 = Vector(deconstruct_person_2.Velocity)
integer_2 = Integer(deconstruct_ptemplate.TemplateID)
text = Text(deconstruct_person_2.NeedSummary)
point_12 = Point(deconstruct_person_2.Position)
point_13 = Point(deconstruct_person_2.CurrentAccessPoint)
mass_addition = MassAddition(Input=[absolute_3, absolute_2, absolute_4])  # -> Result, PartialResults
dispatch = Dispatch(List=gridspeedcounter.AvgSpeed, DispatchPattern=equality.Equality)  # -> ListA, ListB

# ---- group: Ignore small velocity and face target
vector_length = VectorLength(Vector=vector_2)
subtraction = Subtraction(A=point_13, B=point_12)
smaller_than = SmallerThan(FirstNumber=vector_length, SecondNumber="0.001")  # -> SmallerThan, OrEqualTo
vector_3 = Vector(subtraction)
vector_4 = Vector(vector_2)
pick_n_choose = PickNChoose(Pattern=smaller_than.SmallerThan, Stream0=vector_4, Stream1=vector_3)

# ----
subtraction_2 = Subtraction(A=absolute, B=mass_addition.Result)  # -> simplify(Result)
average_2 = Average(Input=dispatch.ListB)  # -> flatten(ArithmeticMean)
integer_3 = Integer(subtraction_2)
panel_8 = Panel(integer_3)
实时平均速度m_s = Panel(average_2)

# ---- group: 3D tags
vector_xyz = VectorXYZ(XComponent=Slider(0, range=-2..2), YComponent=Slider(0, range=-2..2), ZComponent=Slider(2.2, range=-3..3))  # -> Vector, Length
move_2 = Move(Geometry=point_12, Motion=vector_xyz.Vector)  # -> Geometry, Transform
text_tag_2 = TextTag(Location=move_2.Geometry, Text=text, Colour=ColourSwatch(SwatchColor=RGB(0, 0, 0)))  # disabled

# ----
brep = Brep(<brep referenced from the Rhino model>)

# ---- group: 线条颜色
number_slider_14 = Slider(0.72, range=0..1)  # disabled
colour_swatch_2 = ColourSwatch(SwatchColor=RGB(191, 134, 34))  # disabled
create_material = CreateMaterial(Diffuse=colour_swatch_2, Specular=RGB(255, 255, 255), Emission=RGB(0, 0, 0), Transparency=number_slider_14, Shine=0)  # disabled
custom_preview_3 = CustomPreview(Geometry=curve_3, Shader=create_material)  # disabled

# ----
panel_9 = Panel("视野范围")
mesh_brep = MeshBrep(
    Brep=brep,
    Settings={GridMaxCount=0, GridMinCount=16, JaggedSeams=False, MaxEdgeLength=0, MinEdgeLength=0.0001, MinTolerance=0, Refine=True, RefineAngle=0, RelativeTolerance=0.65, SimplePlanes=True, Tolerance=0})
mass_addition_2 = MassAddition(Input=merge_3)  # -> Result, PartialResults
number_3 = Number(mass_addition_2.Result)
number_4 = Number(实时平均速度m_s)
panel_10 = Panel("长路径平均为")
panel_11 = Panel("短时间平均为")
panel_12 = Panel("长时间平均为")
panel_13 = Panel("短路径平均为")

开始行_1 = Slider(3, range=0..50)
_1记录按钮 = Button()
data_recorder = DataRecorder(_1记录按钮, DataLimit=-10, RecordData=True)

multiplication_2 = Multiplication(A=开始行_1, B=2)
series = Series(Start=0, Step=1, Count=multiplication_2)
list_length_2 = ListLength(List=flatten([data_recorder, series]))
division_6 = Division(A=list_length_2, B=2)
round = Round(Number=division_6)  # -> Nearest, Floor, Ceiling
file_path = FilePath("F:\collection.xlsx")
write_options = WriteOptions(
    FilePath=file_path,
    ClearDataOverwrite=Toggle(False),
    SaveAfterWrite=Toggle(True),
    CloseAfterWrite=Toggle(False),
    ColumnStartPosition=1,
    RowStartPosition=round.Floor)  # -> UserMessages, WriteOptions

当前已输入行 = Panel(round.Floor)

# ---- group: 路径
# 清理&记录数据
deconstruct_person_record = DeconstructPersonRecord(PersonRecord=pedsimengine.PersonRecords)  # -> PersonID, TemplateID, StartTime, EndTime, TimeSequence, TracePositions, TraceSpeeds, StateSequence
data_2 = Data(deconstruct_person_record.TracePositions)
间距 = Slider(1.1, range=0..5)
point_14 = Point(<point referenced from the Rhino model>)

# ---- group: 路径 / 完成的点组
tree_statistics = TreeStatistics(Tree=data_2)  # -> Paths, Length, Count
list_item_2 = ListItem(List=tree_statistics.Paths, Index=expr("x-1", tree_statistics.Count), Wrap=True)
split_tree = SplitTree(Data=data_2, Masks=flatten(list_item_2))  # -> Positive, Negative

# ----
# 耗时
subtraction_3 = Subtraction(A=deconstruct_person_record.EndTime, B=deconstruct_person_record.StartTime)  # -> flatten(Result)
# 1s=17帧
division_7 = Division(A=subtraction_3)
data_3 = Data(division_7)
每人耗时_s = Panel(division_7)
average_3 = Average(Input=division_7)
subtraction_4 = Subtraction(A=average_3, B=number_3)
division_8 = Division(A=subtraction_4, B=30)
平均耗时_s = Panel(average_3)
addition = Addition(A=division_8, B=number_3)
number_5 = Number(addition)

# ---- group: Heat map
number_slider_15 = Slider(95, range=0..100)
number_slider_16 = Slider(0.4, range=0..2)
number_slider_17 = Slider(80, range=0..100)
gate_or_2 = GateOr(A=button, B=Button())
point_15 = Point(<point referenced from the Rhino model>)
data_4 = Data(pedsimengine.People)
square_2 = Square(Plane=point_15, Size=number_slider_16, ExtentX=number_slider_15, ExtentY=number_slider_17)  # -> Cells, Points
gridpersoncounter = GridPersonCounter(
    Reset=gate_or_2,
    People=data_4,
    BasePt=point_15,
    CellSize=number_slider_16,
    ExtentX=number_slider_15,
    ExtentY=number_slider_17,
    GridPersonCounterMode=2)  # -> Count, MaxCount
number_slider_18 = Slider(1, range=0..1)
mesh_plane_2 = MeshPlane(Boundary=flatten(square_2.Cells), WidthCount=number_slider_18, HeightCount=number_slider_18)  # -> flatten(Mesh), Area; disabled

# ----
division_9 = Division(A=gridpersoncounter.Count, B=Slider(55, range=0..150))
gradient_2 = Gradient(
    LowerLimit=Slider(0, range=0..1),
    UpperLimit=Slider(1, range=0..2),
    Parameter=expr("1-x", division_9),
    stops=[0: RGB(234, 38, 0), 0.25: RGB(234, 126, 0), 0.5: RGB(254, 244, 84), 0.75: RGB(173, 203, 249), 1: RGB(75, 107, 169)])  # disabled

# ---- group: Heat map (continued)
custom_preview_4 = CustomPreview(Geometry=mesh_plane_2.Mesh, Shader=gradient_2)  # disabled

# ---- group: 路径 / 记录路程
point_16 = Point(split_tree.Positive)

# ----
polyline = PolyLine(Vertices=point_16, Closed=False)
length = Length(Curve=polyline)
data_recorder_2 = DataRecorder(length, DataLimit=1000, RecordData=True)

# ---- group: 路径 / 记录路程 (continued)
delete_consecutive = DeleteConsecutive(Set=data_recorder_2, Wrap=False)  # -> simplify(Set), Count

# ----
panel_14 = Panel(delete_consecutive.Set)
list_length_3 = ListLength(List=delete_consecutive.Set)
list_item_3 = ListItem(List=delete_consecutive.Set, Index=expr("x-1", list_length_3), Wrap=True)

# ---- group: 3D人
panel_16 = Panel("问询人颜色")
panel_17 = Panel("不问询人颜色")
unit_z = UnitZ(Factor=1)
# 人模型
colour_swatch_3 = ColourSwatch(SwatchColor=RGB(77, 184, 196))
panel_18 = Panel("模型")
mesh = Mesh(<mesh referenced from the Rhino model>)
point_17 = Point(<point referenced from the Rhino model>)
vector_5 = Vector(pick_n_choose)
point_18 = Point(point_12)
rotate = Rotate(Vector=vector_5, Axis=unit_z, Angle=degrees(Slider(90, range=0..100)))
merge_6 = Merge(Data1=colour_swatch_3, Data2=ColourSwatch(SwatchColor=RGB(255, 255, 255)))
construct_plane = ConstructPlane(Origin=point_18, XAxis=vector_5, YAxis=rotate)
list_item_4 = ListItem(List=merge_6, Index=integer_2, Wrap=True)
create_material_2 = CreateMaterial(Diffuse=list_item_4, Specular=RGB(255, 255, 255), Emission=list_item_4, Transparency=Slider(0.72, range=0..1), Shine=0)

# ----
mesh_join = MeshJoin(Meshes=[mesh_brep, mesh])

# ---- group: 3D人 (continued)
orient = Orient(Geometry=mesh_join, Source=point_17, Target=construct_plane)  # -> Geometry, Transform
custom_preview_5 = CustomPreview(Geometry=orient.Geometry, Shader=create_material_2)  # disabled

# ----
mass_addition_3 = MassAddition(Input=division_7)  # -> Result, PartialResults
总耗时_s = Panel(mass_addition_3.Result)

# ---- group: 路径 (continued)
flatten_tree = FlattenTree(Tree=list_item_3, Path="{0}")
bounds = Bounds(Numbers=flatten_tree)
average_4 = Average(Input=flatten_tree)
deconstruct_domain = DeconstructDomain(Domain=bounds)  # -> Start, End
最长路径 = Panel(deconstruct_domain.End)
最短路径 = Panel(deconstruct_domain.Start)
平均路径 = Panel(average_4)
number_6 = Number(deconstruct_domain.End)
number_7 = Number(deconstruct_domain.Start)
number_8 = Number(average_4)

# ----
data_5 = Data(flatten_tree)
average_5 = Average(Input=data_5)
larger_than = LargerThan(FirstNumber=data_5, SecondNumber=average_5)  # -> LargerThan, OrEqualTo

mass_addition_4 = MassAddition(Input=flatten_tree)  # -> Result, PartialResults
总路径_m = Panel(mass_addition_4.Result)

dispatch_2 = Dispatch(List=data_5, DispatchPattern=larger_than.LargerThan)  # -> ListA, ListB
dispatch_3 = Dispatch(List=data_3, DispatchPattern=larger_than.LargerThan)  # -> ListA, ListB
每个人路程长度_m = Panel(flatten_tree)
average_6 = Average(Input=dispatch_2.ListB)
average_7 = Average(Input=dispatch_2.ListA)
average_8 = Average(Input=dispatch_3.ListB)
average_9 = Average(Input=dispatch_3.ListA)
number_9 = Number(average_6)
number_10 = Number(average_7)
number_11 = Number(average_8)
number_12 = Number(average_9)
data_6 = Data(dispatch_3.ListA)
data_7 = Data(dispatch_3.ListB)
merge_7 = Merge(
    Data1=number_7,
    Data2=number_6,
    Data3=number_8,
    Data4=number_4,
    Data5=number_5,
    Data6=number_3,
    Data7=number_10,
    Data8=number_9,
    Data9=number_12,
    Data10=number_11)

number_slider_19 = Slider(100, range=0..1000)
multiplication_3 = Multiplication(A=merge_7, B=number_slider_19)
# 取三位小数
round_2 = Round(Number=multiplication_3)  # -> Nearest, Floor, Ceiling
division_10 = Division(A=round_2.Nearest, B=number_slider_19)

write_to_excel = WriteToExcel(
    Run=_1记录按钮,
    ExcelWorksheet="1",
    WriteOptions=write_options.WriteOptions,
    ColumnnsOrRows=True,
    DataToWriteIntoColumns=division_10)

list_item_5 = ListItem(List=division_10, Index=0, Wrap=True)  # -> Item, Item1, Item2, Item3, Item4, Item5, Item6, Item7, Item8, Item9
concatenate = Concatenate(Fragment_A="平均耗时为", Fragment_B=list_item_5.Item4, A="min")
concatenate_2 = Concatenate(Fragment_A="长路径平均为", Fragment_B=list_item_5.Item6, A="m")
concatenate_3 = Concatenate(Fragment_A="处理+等候时长为", Fragment_B=list_item_5.Item5, A="min")
concatenate_4 = Concatenate(Fragment_A="平均速度是", Fragment_B=list_item_5.Item3, A="m/s")
concatenate_5 = Concatenate(Fragment_A="短路径平均为", Fragment_B=list_item_5.Item7, A="m")
concatenate_6 = Concatenate(Fragment_A="长时间平均为", Fragment_B=list_item_5.Item8, A="s")
concatenate_7 = Concatenate(Fragment_A="短时间平均为", Fragment_B=list_item_5.Item9, A="s")
data_8 = Data(dispatch_2.ListA)
data_9 = Data(dispatch_2.ListB)
data_10 = Data(dispatch_3.ListA)
data_11 = Data(dispatch_3.ListB)
data_12 = Data([data_8, data_9])
data_13 = Data([data_10, data_11])
entwine = Entwine(
    Branch00=data_8,
    Branch01=data_9,
    Branch02=data_10,
    Branch03=data_11,
    Branch04=data_12,
    Branch05=data_13,
    FlattenInputs=True)

number_slider_20 = Slider(100, range=0..1000)
multiplication_4 = Multiplication(A=entwine, B=number_slider_20)
round_3 = Round(Number=multiplication_4)  # -> Nearest, Floor, Ceiling
division_11 = Division(A=round_3.Nearest, B=number_slider_20)  # -> simplify(Result)

explode_tree = ExplodeTree(Data=division_11)  # -> Branch0, Branch1, Branch2, Branch3

# ---- group: 路径 (continued)
concatenate_8 = Concatenate(Fragment_A="最长路径为", Fragment_B=list_item_5.Item1, A="m")
concatenate_9 = Concatenate(Fragment_A="最短路径为", Fragment_B=list_item_5.Item, A="m")
concatenate_10 = Concatenate(Fragment_A="平均路径为", Fragment_B=list_item_5.Item2, A="m")
merge_8 = Merge(
    Data1=concatenate_9,
    Data2=concatenate_8,
    Data3=concatenate_10,
    Data4=concatenate_4,
    Data5=concatenate,
    Data6=concatenate_3,
    Data7=concatenate_2,
    Data8=concatenate_5,
    Data9=concatenate_6,
    Data10=concatenate_7)

# ----
list_length_4 = ListLength(List=merge_8)

# ---- group: 路径 (continued)
series_2 = Series(Start=0, Step=间距, Count=list_length_4)
negative = Negative(Value=series_2)
unit_y = UnitY(Factor=negative)
move_3 = Move(Geometry=point_14, Motion=unit_y)  # -> Geometry, Transform
text_tag_3d = TextTag3D(
    Location=move_3.Geometry,
    Text=merge_8,
    Size=Slider(0.6, range=0..4),
    Colour=ColourSwatch(SwatchColor=RGB(61, 61, 61)),
    Justification=4)

# ----
开始行_1_2 = Slider(58, range=0..200)
_1记录按钮_2 = Button()
data_recorder_3 = DataRecorder(_1记录按钮_2, DataLimit=-10, RecordData=True)

multiplication_5 = Multiplication(A=开始行_1_2, B=2)
series_3 = Series(Start=0, Step=1, Count=multiplication_5)
list_length_5 = ListLength(List=flatten([data_recorder_3, series_3]))
division_12 = Division(A=list_length_5, B=2)
round_4 = Round(Number=division_12)  # -> Nearest, Floor, Ceiling
file_path_2 = FilePath("F:\collection for every.xlsx")
write_options_2 = WriteOptions(
    FilePath=file_path_2,
    ClearDataOverwrite=Toggle(False),
    SaveAfterWrite=Toggle(True),
    CloseAfterWrite=Toggle(False),
    ColumnStartPosition=1,
    RowStartPosition=round_4.Floor)  # -> UserMessages, WriteOptions
write_to_excel_2 = WriteToExcel(
    Run=_1记录按钮_2,
    ExcelWorksheet="1",
    WriteOptions=write_options_2.WriteOptions,
    ColumnnsOrRows=False,
    DataToWriteIntoColumns=division_11)

当前已输入行_2 = Panel(round_4.Floor)
